# Grasshopper definition gh_test_interlock.ghx (Grasshopper 1.0.7)

euler_plane = EulerPlane(angle=Slider(182, range=0..360), angle_2=Slider(0, range=0..360), angle_3=0)
deconstruct_plane = DeconstructPlane(Plane=euler_plane)  # -> Origin, XAxis, YAxis, ZAxis
plane = Plane(euler_plane)
vector = Vector(deconstruct_plane.ZAxis)
vector_display = VectorDisplay(Anchor=deconstruct_plane.Origin, Vector=vector)

euler_plane_2 = EulerPlane(angle=Slider(0, range=0..360), angle_2=Slider(0, range=0..360), angle_3=0)
deconstruct_plane_2 = DeconstructPlane(Plane=euler_plane_2)  # -> Origin, XAxis, YAxis, ZAxis
plane_2 = Plane(euler_plane_2)
vector_2 = Vector(deconstruct_plane_2.ZAxis)
vector_display_2 = VectorDisplay(Anchor=deconstruct_plane_2.Origin, Vector=vector_2)

euler_plane_3 = EulerPlane(angle=Slider(180, range=0..360), angle_2=Slider(270, range=0..360), angle_3=0)
deconstruct_plane_3 = DeconstructPlane(Plane=euler_plane_3)  # -> Origin, XAxis, YAxis, ZAxis
plane_3 = Plane(euler_plane_3)
vector_3 = Vector(deconstruct_plane_3.ZAxis)
vector_display_3 = VectorDisplay(Anchor=deconstruct_plane_3.Origin, Vector=vector_3)

euler_plane_4 = EulerPlane(angle=Slider(90, range=0..360), angle_2=Slider(90, range=0..360), angle_3=0)
deconstruct_plane_4 = DeconstructPlane(Plane=euler_plane_4)  # -> Origin, XAxis, YAxis, ZAxis
plane_4 = Plane(euler_plane_4)
vector_4 = Vector(deconstruct_plane_4.ZAxis)
vector_display_4 = VectorDisplay(Anchor=deconstruct_plane_4.Origin, Vector=vector_4)

euler_plane_5 = EulerPlane(angle=Slider(90, range=0..360), angle_2=Slider(0, range=0..360), angle_3=0)
euler_plane_6 = EulerPlane(angle=Slider(90, range=0..360), angle_2=Slider(180, range=0..360), angle_3=0)
deconstruct_plane_5 = DeconstructPlane(Plane=euler_plane_5)  # -> Origin, XAxis, YAxis, ZAxis
deconstruct_plane_6 = DeconstructPlane(Plane=euler_plane_6)  # -> Origin, XAxis, YAxis, ZAxis
plane_5 = Plane(euler_plane_5)
vector_5 = Vector(deconstruct_plane_5.ZAxis)
plane_6 = Plane(euler_plane_6)
vector_6 = Vector(deconstruct_plane_6.ZAxis)
vector_display_5 = VectorDisplay(Anchor=deconstruct_plane_5.Origin, Vector=vector_5)
vector_display_6 = VectorDisplay(Anchor=deconstruct_plane_6.Origin, Vector=vector_6)

merge = Merge(Data1=vector_6, Data2=vector_5, Data3=vector_4, Data4=vector_3, Data5=vector_2, Data6=vector)
ghpython_script = GhPythonScript(reconnect=Toggle(False))  # -> out, a; inputs reconnect: Boolean
# ---------- ghpython_script: Python ----------
from compas.rpc import Proxy

if reconnect:
    interlock_utils = Proxy('choreo.interlock.utils')
    interlock_utils.stop_server()
# ---------- end ghpython_script ----------
ghpython_script_2 = GhPythonScript(block_dirs=merge)  # -> out, simplify(feasible_region_rays), linear_index_set; inputs block_dirs: list
# ---------- ghpython_script_2: Python ----------
import rhinoscriptsyntax as rs
from ghpythonlib.treehelpers import list_to_tree

from compas.rpc import Proxy

interlock_utils = Proxy('choreo.interlock.utils')

def rvector2list(rv):
    return [rv.X, rv.Y, rv.Z]
#block_dirs = [[1, 0, -1], [-1, 0, -1], \
#              [0, 1, 0], [0, -1, 0]]

bdir_lists = [rvector2list(rv) for rv in block_dirs]
print(bdir_lists)

rays, lin_set = interlock_utils.computeFeasibleRegionFromBlockDir(bdir_lists)

feasible_region_rays = list_to_tree(rays)
linear_index_set = list_to_tree(lin_set, source=[0,0])
# ---------- end ghpython_script_2 ----------
vector_display_7 = VectorDisplay(Anchor=deconstruct_plane.Origin, Vector=merge)
panel = Panel(ghpython_script.out)
list_item = ListItem(List=ghpython_script_2.feasible_region_rays, Index=0, Wrap=True)  # -> Item, Item1, Item2
vector_xyz = VectorXYZ(XComponent=list_item.Item, YComponent=list_item.Item1, ZComponent=list_item.Item2)  # -> Vector, Length
vector_7 = Vector(unitize(vector_xyz.Vector))
panel_2 = Panel(ghpython_script_2.linear_index_set)
panel_3 = Panel(ghpython_script_2.feasible_region_rays)
vector_display_ex = VectorDisplayEx(Vector=vector_7, Colour=RGB(0, 0, 0), Width=2)

# ==== cluster EulerPlane
xy_plane = XYPlane(Origin=Point(0, 0, 0))
deconstruct_plane = DeconstructPlane(Plane=xy_plane)  # -> Origin, XAxis, YAxis, ZAxis
line_sdl = LineSDL(Start=deconstruct_plane.Origin, Direction=deconstruct_plane.XAxis, Length=1)
angle = ClusterInput()
rotate_axis = RotateAxis(Geometry=xy_plane, Angle=degrees(angle), Axis=line_sdl)  # -> Geometry, Transform
plane = Plane(rotate_axis.Geometry)
deconstruct_plane_2 = DeconstructPlane(Plane=plane)  # -> Origin, XAxis, YAxis, ZAxis
line_sdl_2 = LineSDL(Start=deconstruct_plane_2.Origin, Direction=deconstruct_plane_2.YAxis, Length=1)
angle_2 = ClusterInput()
rotate_axis_2 = RotateAxis(Geometry=plane, Angle=degrees(angle_2), Axis=line_sdl_2)  # -> Geometry, Transform
plane_2 = Plane(rotate_axis_2.Geometry)
deconstruct_plane_3 = DeconstructPlane(Plane=plane_2)  # -> Origin, XAxis, YAxis, ZAxis
line_sdl_3 = LineSDL(Start=deconstruct_plane_3.Origin, Direction=deconstruct_plane_3.ZAxis, Length=1)
angle_3 = ClusterInput()
rotate_axis_3 = RotateAxis(Geometry=plane_2, Angle=degrees(angle_3), Axis=line_sdl_3)  # -> Geometry, Transform
geometry = ClusterOutput(rotate_axis_3.Geometry)
